% Simulink data dictionary train_dynamics.sldd

dynamics_params = Simulink.Bus()
  brake_force_lbs: double
  initialVelocity: double
  gearRatio: double
  maxTorque: double
  grade: double
  nCars: double
  nTugVolts: double
  massPerCar: double
  massPerTug: double
  motorsPerTug: double
  Ts: double

Ts = Simulink.Parameter(0.05, StorageClass="Struct", StructName="dynamic_params")
grade = Simulink.Parameter(0)
pInit = Simulink.Parameter(0)
Sig = Simulink.Signal()
direction_int = Simulink.Parameter(1)
vInit = Simulink.Parameter(0)
nTugVolts = Simulink.Parameter(1)
nMotorsPerTug = Simulink.Parameter(1)
nCars = Simulink.Parameter(0)
maxTorque = Simulink.Parameter(260)
massPerTug = Simulink.Parameter(27272.73)
massPerCar = Simulink.Parameter(27272.73)
gearRatio = Simulink.Parameter(16)
static_friction_coef = Simulink.Parameter(0.9)
dynamic_friction_coef = Simulink.Parameter(0.7)
rolling_resistance_coef = Simulink.Parameter(0.0015)
wheel_radius = Simulink.Parameter(0.4572)

wheel_slip = Simulink.Bus()
  w1: double
  w2: double
  w3: double
  w4: double

brake_force = Simulink.Parameter(90000, Unit="N")